# Grasshopper definition xmas_tree_sequences_joseluis.ghx (Grasshopper 1.0.7)

# ---- group: Load LED spatial locations
c_script = CSharpScript()  # -> out, here
# ---------- c_script: C# usings ----------
using System.IO;
# ---------- c_script: C# ----------
    string targetFolder = "";

    GH_Document gh_d = owner.OnPingDocument();
    if (gh_d.IsFilePathDefined)
    {
      string ghFilePath = gh_d.FilePath;
      targetFolder = Path.GetDirectoryName(ghFilePath);
    }
    else
    {
      Print("No local folder found, please save your file first.");
    }

    here = targetFolder;
# ---------- end c_script ----------
concat = Concatenate(FragmentA=c_script.here, FragmentB="\", FragmentC="coords_adjusted_normalized.csv")
panel = Panel(concat)
file = ReadFile(File=concat, PerLineParse=True)
panel_2 = Panel(file)
split = SplitList(List=file, Index="1")  # -> ListA, ListB
panel_3 = Panel(split.ListB)
c_script_2 = CSharpScript(coord=split.ListB)  # -> out, P; inputs coord: String
# ---------- c_script_2: C# ----------
  
    string[] parts = coord.Split(',');
    
    double x = 0, y = 0, z = 0;
    try
    {
      x = Double.Parse(parts[1]);
      y = Double.Parse(parts[2]);
      z = Double.Parse(parts[3]);
    }
    catch (Exception ex)
    {
      Component.AddRuntimeMessage(
      GH_RuntimeMessageLevel.Error, 
      "Invalid string: " + ex.ToString());
    }
    
    Point3d p = new Point3d(x, y, z);
    
    
    P = p;
# ---------- end c_script_2 ----------
panel_4 = Panel(c_script_2.P)
pt = Point(c_script_2.P)

# ----
pt_2 = Point(<point referenced from the Rhino model>)

# ---- group: FLUSH
c_script_3 = CSharpScript(leds=pt, fps=Slider(60, range=0..100), duration=Slider(10, range=0..10))  # -> out, CSV; inputs leds: list of Point3d, fps: Int32, duration: Int32
# ---------- c_script_3: C# ----------
    // Algorithm

    // How many lights do we have?
    int ledCount = leds.Count;

    // Prepare the basics of our CSV file
    List<string> csv = new List<string>();

    // Add the header, looking like:
    // "FRAME_ID,R_0,G_0,B_0,R_1,G_1,B_1..."
    string row = "FRAME_ID,";
    for (int i = 0; i < ledCount; i++)
    {
      row += "R_" + i + ",G_" + i + ",B_" + i;
      if (i != ledCount - 1)
      {
        row += ",";
      }
    }
    csv.Add(row);

    // Total length of animation
    int frameCount = fps * duration;

    // Generate rows for each frame
    for (int f = 0; f < frameCount; f++)
    {
      row = f + ",";

      // Calculate the values for each LED
      int r, g, b;
      for (int i = 0; i < ledCount; i++)
      {
        // Calculate RGB values for each LED

        // For this one, all LEDs are black.
        r = 0;
        g = 0;
        b = 0;

        // Add these colors to the row
        row += r + "," + g + "," + b;
        if (i != ledCount - 1)
        {
          row += ",";
        }
      }

      // Add this row to the CSV
      csv.Add(row);
    }


    // Outputs
    CSV = csv;
# ---------- end c_script_3 ----------
panel_5 = Panel(c_script_3.CSV)
concat_2 = Concatenate(FragmentA=c_script.here, FragmentB="\", FragmentC="flush.csv")
c_script_4 = CSharpScript(csv=c_script_3.CSV, path=concat_2)  # -> out; inputs csv: list of String, path: String
# ---------- c_script_4: C# usings ----------
using System.IO;
using System.Text;
# ---------- c_script_4: C# ----------
  
    try 
    {
      File.WriteAllLines(path, csv, Encoding.UTF8);
      Print("File successfully saved on " + DateTime.Now);
    }
    catch (Exception ex)
    {
      this.Component.AddRuntimeMessage(
        GH_RuntimeMessageLevel.Error,
        "Could not save file, error: " + ex);
    }
# ---------- end c_script_4 ----------
panel_6 = Panel(c_script_4)

# ----
concat_3 = Concatenate(FragmentA=c_script.here, FragmentB="\", FragmentC="pulse-red.csv")

# ---- group: PULSE UNIFORM
c_script_5 = CSharpScript(leds=pt, fps=Slider(60, range=0..100), duration=Slider(2, range=0..10))  # -> out, CSV; inputs leds: list of Point3d, fps: Int32, duration: Int32
# ---------- c_script_5: C# ----------
    // Algorithm

    // How many lights do we have?
    int ledCount = leds.Count;

    // Prepare the basics of our CSV file
    List<string> csv = new List<string>();

    // Add the header, looking like:
    // "FRAME_ID,R_0,G_0,B_0,R_1,G_1,B_1..."
    string row = "FRAME_ID,";
    for (int i = 0; i < ledCount; i++)
    {
      row += "R_" + i + ",G_" + i + ",B_" + i;
      if (i != ledCount - 1)
      {
        row += ",";
      }
    }
    csv.Add(row);

    // Total length of animation
    int frameCount = fps * duration;

    // Angle step for each frame
    double thetaStep = 2 * Math.PI / frameCount;

    // Generate rows for each frame
    for (int f = 0; f < frameCount; f++)
    {
      row = f + ",";

      double theta = thetaStep * f;
      double amplitude = 0.5 + 0.5 * Math.Sin(theta - 0.5 * Math.PI);
      Print("Frame " + f + ", theta: " + theta + ", amplitude: " + amplitude);

      // Calculate the values for each LED
      int r, g, b;
      for (int i = 0; i < ledCount; i++)
      {
        // Calculate RGB values for each LED
        int brightness = (int) Math.Round(255 * amplitude);

        // For this one, all LEDs are black.
        r = brightness;
        g = 0;
        b = 0;

        // Add these colors to the row
        row += r + "," + g + "," + b;
        if (i != ledCount - 1)
        {
          row += ",";
        }
      }

      // Add this row to the CSV
      csv.Add(row);
    }


    // Outputs
    CSV = csv;
# ---------- end c_script_5 ----------
panel_7 = Panel(c_script_5.CSV)
c_script_6 = CSharpScript(csv=c_script_5.CSV, path=concat_3)  # -> out; inputs csv: list of String, path: String; same code as c_script_4
panel_8 = Panel(c_script_6)

# ----
concat_4 = Concatenate(FragmentA=c_script.here, FragmentB="\", FragmentC="lighthouse.csv")

# ---- group: ROTATING LIGHT
c_script_7 = CSharpScript(leds=pt, fps=Slider(60, range=0..100), duration=Slider(8, range=0..10), center=pt_2, width=Slider(45, range=0..100))  # -> out, CSV; inputs leds: list of Point3d, fps: Int32, duration: Int32, center: Point3d, width: Double
# ---------- c_script_7: C# usings ----------
using System.Drawing;
# ---------- c_script_7: C# ----------
    // Algorithm

    // How many lights do we have?
    int ledCount = leds.Count;

    // Prepare the basics of our CSV file
    List<string> csv = new List<string>();

    // Add the header, looking like:
    // "FRAME_ID,R_0,G_0,B_0,R_1,G_1,B_1..."
    string row = "FRAME_ID,";
    for (int i = 0; i < ledCount; i++)
    {
      row += "R_" + i + ",G_" + i + ",B_" + i;
      if (i != ledCount - 1)
      {
        row += ",";
      }
    }
    csv.Add(row);

    // Total length of animation
    int frameCount = fps * duration;

    double step = 360.0 / frameCount;
    double diff = 360 - width;




    // Generate rows for each frame
    for (int f = 0; f < frameCount; f++)
    {
      row = f + ",";
      
      double frameAngle = f * step;

      // Calculate the values for each LED
      int r, g, b, brightness;
      for (int i = 0; i < ledCount; i++)
      {
        double dx = leds[i].X - center.X;
        double dy = leds[i].Y - center.Y;
        //                double angle = Math.Atan2(dy, dx) * 180 / Math.PI;  // ranges between [-180, 180]
        double ledAngle = Math.Atan2(dy, dx) * 180 / Math.PI + 180;  // ranges between [0, 360]

        if (ledAngle > frameAngle + diff) ledAngle -= 360;
        else if (ledAngle < frameAngle - diff) ledAngle += 360;

        brightness = 0;
        double d = frameAngle - ledAngle;
        if (d > -width && d < width)
        {
          brightness = (int) (255 * (1 - Math.Abs(d) / width));
        }

        r = brightness;
        g = brightness;
        b = brightness;

        // Add these colors to the row
        row += r + "," + g + "," + b;
        if (i != ledCount - 1)
        {
          row += ",";
        }
      }

      // Add this row to the CSV
      csv.Add(row);
    }


    // Outputs
    CSV = csv;
# ---------- c_script_7: C# additional code ----------
  // From https://stackoverflow.com/a/1626232/1934487
  public static void ColorToHSV(Color color, out double hue, out double saturation, out double value)
  {
    int max = Math.Max(color.R, Math.Max(color.G, color.B));
    int min = Math.Min(color.R, Math.Min(color.G, color.B));

    hue = color.GetHue();
    saturation = (max == 0) ? 0 : 1d - (1d * min / max);
    value = max / 255d;
  }

  // From https://stackoverflow.com/a/1626232/1934487
  public static Color ColorFromHSV(double hue, double saturation, double value)
  {
    int hi = Convert.ToInt32(Math.Floor(hue / 60)) % 6;
    double f = hue / 60 - Math.Floor(hue / 60);

    value = value * 255;
    int v = Convert.ToInt32(value);
    int p = Convert.ToInt32(value * (1 - saturation));
    int q = Convert.ToInt32(value * (1 - f * saturation));
    int t = Convert.ToInt32(value * (1 - (1 - f) * saturation));

    if (hi == 0)
      return Color.FromArgb(255, v, t, p);
    else if (hi == 1)
      return Color.FromArgb(255, q, v, p);
    else if (hi == 2)
      return Color.FromArgb(255, p, v, t);
    else if (hi == 3)
      return Color.FromArgb(255, p, q, v);
    else if (hi == 4)
      return Color.FromArgb(255, t, p, v);
    else
      return Color.FromArgb(255, v, p, q);
  }
# ---------- end c_script_7 ----------
panel_9 = Panel(c_script_7.CSV)
c_script_8 = CSharpScript(csv=c_script_7.CSV, path=concat_4)  # -> out; inputs csv: list of String, path: String; same code as c_script_4
panel_10 = Panel(c_script_8)

# ----
txt = Text()
txt_2 = Text(c_script_3.CSV)
txt_3 = Text(c_script_7.CSV)
txt_4 = Text()
txt_5 = Text()
txt_6 = Text()
txt_7 = Text()
trigger = Trigger(Interval=33, TimerInterval=33, Target=c_script_9)  # disabled
split_2 = SplitList(List=txt_3, Index="1")  # -> ListA, ListB

# ---- group: Per-frame simulation
c_script_9 = CSharpScript(csv=split_2.ListB, reset=Button(), loop=Toggle(True), minAlpha=Slider(152, range=0..255))  # -> out, renderedFrame, ledCount, colors, transparencies; inputs csv: list of String, reset: Boolean, loop: Boolean, minAlpha: Int32
# ---------- c_script_9: C# ----------
    // Algorithm

    // Do we need to reset?
    if (reset)
    {
      currentFrame = 0;
    }

    // Calculate total amount of frames
    int totalFrames = csv.Count - 1;

    // Select the row that contains the current frame to render
    string currentCSV = csv[currentFrame];

    // Splir the string into individual values
    string[] data = currentCSV.Split(',');

    // Calculate amount of ledLights
    int leds = (data.Length - 1) / 3;

    // Iterate over all the data points (minus the id)
    Color[] clrs = new Color[leds];
    double[] trans = new double[leds];
    for (int i = 0; i < leds; i++)
    {
      string strR = data[1 + 3 * i];
      string strG = data[1 + 3 * i + 1];
      string strB = data[1 + 3 * i + 2];

      int r = Int32.Parse(strR);
      int g = Int32.Parse(strG);
      int b = Int32.Parse(strB);

      int a = (r + g + b) / 3;
      if (a < minAlpha)
      {
        a = minAlpha;
      }

      double t = 1.0 - (a / 255.0);
      trans[i] = t;

      clrs[i] = Color.FromArgb(a, r, g, b);

    }

    // Update for next iteration
    currentFrame++;

    // Figure out if frame value is valid
    if (currentFrame > totalFrames - 1)
    {
      if (loop)
      {
        currentFrame = 0;
      }
      else
      {
        currentFrame = totalFrames - 1;
      }
    }


    // Outputs
    renderedFrame = currentFrame;
    ledCount = leds;
    colors = clrs;
    transparencies = trans;
# ---------- c_script_9: C# additional code ----------
  int currentFrame = 0;
# ---------- end c_script_9 ----------
panel_11 = Panel(c_script_9.colors)  # disabled
panel_12 = Panel(c_script_9.ledCount)
panel_13 = Panel(c_script_9.transparencies)  # disabled

# ----
panel_14 = Panel(c_script_9.renderedFrame)

# ---- group: Custom Rendering
number_slider = Slider(5, range=0..10)
material = CreateMaterial(
    Diffuse=c_script_9.colors,
    Specular=RGB(255, 255, 255),
    Emission=RGB(0, 0, 0),
    Transparency=c_script_9.transparencies,
    Shine=0)
msphere = MeshSphere(Base=pt, Radius=Slider(0.02, range=0..1), UCount=number_slider, VCount=number_slider)
preview = CustomPreview(Geometry=msphere, Material=material)
